# Grasshopper definition simple_radiance_utci.gh (Grasshopper 1.0.7)

panel = Panel("""0
1
2""")
panel_2 = Panel("E:\Current Cases\Grasshopper Plugin")
geo = Geometry([<brep referenced from the Rhino model> x10])
roomsolid = HBRoomFromSolid(geo=flatten(geo), conditioned=True)  # -> report, rooms; plug-in component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
download = GhPythonScript(
    project="Outdoor Comfort Example",
    simulation="Pedestrian Wind Comfort 2",
    run="Run 1",
    resolution="25",
    path=panel_2,
    run_2=Toggle(True))  # -> out
# ---------- download: Python ----------
__author__ = "DarrenLynch"
__version__ = "2021.12.10"

import rhinoscriptsyntax as rs
#Start of GH code
import subprocess

if project == None:
    raise Exception("project name is undefined")
if simulation == None:
    raise Exception("simulation name is undefined")
if run == None:
    raise Exception("run name is undefined")
if path == None:
    raise Exception("path is undefined")
if resolution == None:
    raise Exception(
        "resolution is undefined, should be >=0m, but best bellow 10m")
if _run == None:
    raise Exception("_run is undefined, should be boolean")
if not _run:
    string = "to start downloading, toggle _run to True"
    output = string
    raise Warning(string)
    
    
if _run:
    #Hide the cmd window
    si = subprocess.STARTUPINFO()
    si.dwFlags |= subprocess.STARTF_USESHOWWINDOW
    
    ##call the main cli function to download and process results
    download_return_code = subprocess.Popen(['simscale',
                                        'download_pwc_results',
                                         project,
                                         simulation,
                                         run,
                                         str(resolution),
                                         path], 
                                         stdout=subprocess.PIPE,
                                         stderr=subprocess.PIPE,
                                         startupinfo=si)
    
    output, error = download_return_code.communicate()
    output = output.decode("utf-8")
    if error != None:
        error = error.decode("utf-8")
        if (error.find('Exception') != -1):
            raise Exception(error)
    
    print(output)
# ---------- end download ----------
recipesettings = HBRecipeSettings(folder=panel_2, reload_old=False)  # -> settings; plug-in component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
analysisperiod = LBAnalysisPeriod(start_month="4", start_day=1, start_hour="9", end_month="6", end_hour="16")  # -> period, hoys, dates; plug-in component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
model = HBModel(rooms=flatten(roomsolid.rooms))  # -> report, model; plug-in component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
panel_3 = Panel("https://energyplus-weather.s3.amazonaws.com/north_and_central_america_wmo_region_4/USA/MA/USA_MA_Boston-Logan.Intl.AP.725090_TMY/USA_MA_Boston-Logan.Intl.AP.725090_TMY.zip")
panel_4 = Panel(download)
analysisperiod_2 = LBAnalysisPeriod(start_month=6, start_day=1, start_hour=12, end_month=6, end_day=1, end_hour=15)  # -> period, hoys, dates; plug-in component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
downloadepw = LBDownloadWeather(weather_URL=panel_3)  # -> epw_file, stat_file, ddy_file; plug-in component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
importepw = LBImportEPW(epw_file=downloadepw.epw_file)  # -> location, dry_bulb_temperature, dew_point_temperature, relative_humidity, wind_speed, wind_direction, direct_normal_rad, diffuse_horizontal_rad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; plug-in component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
applyper = LBApplyAnalysisPeriod(data=importepw.wind_speed, period=analysisperiod.period)  # -> data; plug-in component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
applyper_2 = LBApplyAnalysisPeriod(data=importepw.wind_direction, period=analysisperiod.period)  # -> data; plug-in component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
xdata = LBDeconstructData(data=applyper)  # -> header, values; plug-in component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
windrose = LBWindRose(data=applyper, wind_direction=applyper_2)  # -> report, mesh, compass, orient_line, freq_line, windrose_line, legend, title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; plug-in component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
toggle = BooleanToggle(True)
avr = Average(Input=xdata.values)
toggle_2 = BooleanToggle(True)
wind_speed = GhPythonScript(direction=windrose.prevailing, meteo_speed=avr, path=panel_2, run=toggle_2)  # -> out, speed
# ---------- wind_speed: Python ----------
__author__ = "DarrenLynch"
__version__ = "2021.12.13"

import rhinoscriptsyntax as rs
import subprocess
import ast

if _run:
    #Hide the cmd window
    si = subprocess.STARTUPINFO()
    si.dwFlags |= subprocess.STARTF_USESHOWWINDOW
    read_speed_code = subprocess.Popen(['simscale',
                                        'cast-speed',
                                         path,
                                         str(direction),
                                         str(meteo_speed)], 
                                         stdout=subprocess.PIPE,
                                         stderr=subprocess.PIPE,
                                         startupinfo=si)
    
    output, error = read_speed_code.communicate()
    output = output.decode("utf-8")
    speed = ast.literal_eval(output)
    if error != None:
        error = error.decode("utf-8")
        if (error.find('Exception') != -1):
            raise Exception(error)
# ---------- end wind_speed ----------
item = ListItem(List=wind_speed.speed, Index=panel, Wrap=True)
points = Points(path=panel_2, run=toggle_2)  # -> pt_2, M
item_2 = ListItem(List=points.pt_2, Index=panel, Wrap=True)
sensorgrid = HBSensorGrid(positions=points.pt_2)  # -> grid; plug-in component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
assigngridsviews = HBAssignGridsAndViews(model=model.model, grids=graft(sensorgrid))  # -> model; plug-in component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
utcimap = HBUTCIComfortMap(
    model=assigngridsviews,
    epw=downloadepw.epw_file,
    ddy=downloadepw.ddy_file,
    run_period=analysisperiod_2.period,
    run_settings=recipesettings,
    run=toggle)  # -> report, utci, condition, category, TCP, HSP, CSP; plug-in component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
thermalmtx = HBReadThermalMatrix(comf_result=utcimap.utci, load=toggle)  # -> comf_mtx; plug-in component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
panel_5 = Panel(utcimap.utci)
panel_6 = Panel(wind_speed.speed)
panel_7 = Panel(points.pt_2)
panel_8 = Panel(points.M)
xmatrix = LBDeconstructMatrix(matrix=thermalmtx)  # -> values; plug-in component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
timeop = LBTimeIntervalOperation(data=xmatrix)  # -> daily, monthly, mon_per_hr; plug-in component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
xdata_2 = LBDeconstructData(data=xmatrix)  # -> header, values; plug-in component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
avr_2 = Average(Input=xdata_2.values)
del = DelaunayMesh(Points=item_2, Plane=PlaneXY(0, 0, 0))
heatmap = LBSpatialHeatmap(values=avr_2, mesh=del)  # -> mesh, legend, title, colors, legend_par; plug-in component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

# ==== cluster Points
path = ClusterInput()
run = ClusterInput()
points = GhPythonScript(path=path, run=run)  # -> out, X, Y, Z
# ---------- points: Python ----------
__author__ = "DarrenLynch"
__version__ = "2021.12.13"

import rhinoscriptsyntax as rs
import subprocess
import ast

if _run:
    #Hide the cmd window
    si = subprocess.STARTUPINFO()
    si.dwFlags |= subprocess.STARTF_USESHOWWINDOW
    
    read_x_code = subprocess.Popen(['simscale',
                                        'cast-ordinate',
                                         path,
                                         'X'],
                                         stdout=subprocess.PIPE,
                                         stderr=subprocess.PIPE,
                                         startupinfo=si)
    
    output, error = read_x_code.communicate()
    output = output.decode("utf-8")
    X = ast.literal_eval(output)
    if error != None:
        error = error.decode("utf-8")
        if (error.find('Exception') != -1):
            raise Exception(error)
            
    read_y_code = subprocess.Popen(['simscale',
                                        'cast-ordinate',
                                         path,
                                         'Y'],
                                         stdout=subprocess.PIPE,
                                         stderr=subprocess.PIPE,
                                         startupinfo=si)
    
    output, error = read_y_code.communicate()
    output = output.decode("utf-8")
    Y = ast.literal_eval(output)
    if error != None:
        error = error.decode("utf-8")
        if (error.find('Exception') != -1):
            raise Exception(error)
            
    read_z_code = subprocess.Popen(['simscale',
                                        'cast-ordinate',
                                         path,
                                         'Z'],
                                         stdout=subprocess.PIPE,
                                         stderr=subprocess.PIPE,
                                         startupinfo=si)
    
    output, error = read_z_code.communicate()
    output = output.decode("utf-8")
    Z = ast.literal_eval(output)
    if error != None:
        error = error.decode("utf-8")
        if (error.find('Exception') != -1):
            raise Exception(error)
# ---------- end points ----------
pt = ConstructPoint(XCoordinate=points.X, YCoordinate=points.Y, ZCoordinate=points.Z)
del = DelaunayMesh(Points=pt, Plane=PlaneXY(0, 0, 0))
pt_2 = ClusterOutput(pt)
M = ClusterOutput(del)
